# Grasshopper definition Wall_Coming.gh (Grasshopper 1.0.7)
# plug-ins: gHowl, Pufferfish, XiRui, GHxUnity

trigger = Trigger(Interval=100, TimerInterval=100, Target=unity2gh_qrcode)  # disabled
unity2gh_qrcode = Unity2GH_QRCode()
deconstruct_plane = DeconstructPlane(Plane=unity2gh_qrcode)  # -> Origin, XAxis, YAxis, ZAxis
trigger_2 = Trigger(Interval=100, TimerInterval=100, Target=unity2gh_hl)
xy_plane = XYPlane(Origin=Point(0, 0, 0))
network_source = NetworkSource()  # -> NetworkAdapterIsUp, AdapterProperties, LocalIpAddress
negative = Negative(Value=deconstruct_plane.ZAxis)
deconstruct_plane_2 = DeconstructPlane(Plane=xy_plane)  # -> Origin, XAxis, YAxis, ZAxis
construct_plane = ConstructPlane(Origin=deconstruct_plane.Origin, XAxis=deconstruct_plane.XAxis, YAxis=negative)
udp_receiver = UDPReceiver(Address=network_source.LocalIpAddress, Port="8989", Pattern=0)  # -> Info, Data
text_split = TextSplit(Text=udp_receiver.Data)
gh2unity_qrcode = GH2Unity_QRCode(Position=deconstruct_plane_2.Origin, XAxis=deconstruct_plane_2.XAxis, YAxis=deconstruct_plane_2.YAxis, Content="MR_1")
panel = Panel(network_source.LocalIpAddress)
data_recorder = DataRecorder(udp_receiver.Data, DataLimit=1, RecordData=False)
unity2gh_hl = Unity2GH_HL()
c_script = CSharpScript(x=text_split)  # -> out, a; inputs x: list of String
# ---------- c_script: C# usings ----------
using System.Linq;
# ---------- c_script: C# ----------
    List<List<string>> groups = new List<List<string>>();
    List<string> currentGroup = new List<string>();


    foreach (string item in x)
    {
      if (item == "")
      {
        if (currentGroup.Any())
        {
          groups.Add(currentGroup);
          currentGroup = new List<string>();
        }
      }
      else
      {
        currentGroup.Add(item);
      }
    }

    if (currentGroup.Any())
    {
      groups.Add(currentGroup);
    }

    List<string> combinedGroup = groups.Select(sublist => string.Join("\n", sublist)).ToList();
    a = combinedGroup.ToArray();
# ---------- end c_script ----------
list_item = ListItem(List=c_script.a, Index=0, Wrap=True)
orient = Orient(Geometry=unity2gh_hl, Source=construct_plane, Target=xy_plane)  # -> Geometry, Transform
text_split_2 = TextSplit(Text=data_recorder)
panel_2 = Panel(udp_receiver.Data)  # disabled
text_split_3 = TextSplit(Text=list_item)
c_script_2 = CSharpScript(x=text_split_2)  # -> out, a; inputs x: list of String; same code as c_script
list_item_2 = ListItem(List=c_script_2.a, Index=0, Wrap=True)
text_split_4 = TextSplit(Text=list_item_2)
split_list = SplitList(List=text_split_3, Index="1")  # -> ListA, ListB
split_list_2 = SplitList(List=text_split_4, Index="1")  # -> ListA, ListB
text_split_5 = TextSplit(Text=split_list.ListB, Separators=" ")  # -> simplify(Result)
text_split_6 = TextSplit(Text=split_list_2.ListB, Separators=" ")  # -> simplify(Result)
list_item_3 = ListItem(List=text_split_5, Index=0, Wrap=True)  # -> Item, Item1, Item2
construct_point = ConstructPoint(XCoordinate=list_item_3.Item, YCoordinate=list_item_3.Item1, ZCoordinate=list_item_3.Item2)
list_item_4 = ListItem(List=text_split_6, Index=0, Wrap=True)  # -> Item, Item1, Item2
construct_point_2 = ConstructPoint(XCoordinate=0, YCoordinate=0, ZCoordinate=0)
construct_point_3 = ConstructPoint(XCoordinate=list_item_4.Item, YCoordinate=list_item_4.Item1, ZCoordinate=list_item_4.Item2)
construct_point_4 = ConstructPoint(XCoordinate=0, YCoordinate=0, ZCoordinate=0)
distance = Distance(PointA=construct_point, PointB=construct_point_2)
panel_3 = Panel(construct_point_3)
distance_2 = Distance(PointA=construct_point_3, PointB=construct_point_4)
smaller_than = SmallerThan(FirstNumber=distance, SecondNumber="0.001")  # -> SmallerThan, OrEqualTo
smaller_than_2 = SmallerThan(FirstNumber=distance_2, SecondNumber="0.001")  # -> SmallerThan, OrEqualTo
member_index = MemberIndex(Set=smaller_than.SmallerThan, Member=Toggle(True))  # -> Index, Count
null_placeholder = NullPlaceholder()
member_index_2 = MemberIndex(Set=smaller_than_2.SmallerThan, Member=Toggle(True))  # -> Index, Count
replace_items = ReplaceItems(List=construct_point, Item=null_placeholder, Indices=member_index.Index, Wrap=False)
null_placeholder_2 = NullPlaceholder()
replace_items_2 = ReplaceItems(List=construct_point_3, Item=null_placeholder_2, Indices=member_index_2.Index, Wrap=False)
flatten_tree = FlattenTree(Tree=replace_items, Path="{0}")
flatten_tree_2 = FlattenTree(Tree=replace_items_2, Path="{0}")
deconstruct = Deconstruct(Point=flatten_tree)  # -> XComponent, YComponent, ZComponent
panel_4 = Panel(flatten_tree)
deconstruct_2 = Deconstruct(Point=flatten_tree_2)  # -> XComponent, YComponent, ZComponent
negative_2 = Negative(Value=deconstruct.XComponent)
construct_point_5 = ConstructPoint(XCoordinate=negative_2, YCoordinate=deconstruct.ZComponent, ZCoordinate=deconstruct.YComponent)
negative_3 = Negative(Value=deconstruct_2.XComponent)
construct_point_6 = ConstructPoint(XCoordinate=negative_3, YCoordinate=deconstruct_2.ZComponent, ZCoordinate=deconstruct_2.YComponent)
panel_5 = Panel("""2
5""")

# ---- group: Nose-Neck
panel_6 = Panel("""0
1""")
list_item_5 = ListItem(List=construct_point_5, Index=panel_6, Wrap=True)
polyline = PolyLine(Vertices=list_item_5, Closed=False)

# ---- group: Neck->Right Wrist
panel_7 = Panel("""1
2
3
4""")
list_item_6 = ListItem(List=construct_point_5, Index=panel_7, Wrap=True)
polyline_2 = PolyLine(Vertices=list_item_6, Closed=False)

# ---- group: Neck->Left Wrist
panel_8 = Panel("""1
5
6
7""")
list_item_7 = ListItem(List=construct_point_5, Index=panel_8, Wrap=True)
polyline_3 = PolyLine(Vertices=list_item_7, Closed=False)

# ---- group: Left Hip <->Right Hip
panel_9 = Panel("""8
11""")
list_item_8 = ListItem(List=construct_point_5, Index=panel_9, Wrap=True)
polyline_4 = PolyLine(Vertices=list_item_8, Closed=False)

# ---- group: Right Shoulder->Right Feet
panel_10 = Panel("""2
8
9
10""")
list_item_9 = ListItem(List=construct_point_5, Index=panel_10, Wrap=True)
polyline_5 = PolyLine(Vertices=list_item_9, Closed=False)

# ---- group: Left Shoulder->Left Feet
panel_11 = Panel("""5
11
12
13""")
list_item_10 = ListItem(List=construct_point_5, Index=panel_11, Wrap=True)
polyline_6 = PolyLine(Vertices=list_item_10, Closed=False)

# ---- group: Nose->Right Ear
panel_12 = Panel("""0
14
16""")
list_item_11 = ListItem(List=construct_point_5, Index=panel_12, Wrap=True)
polyline_7 = PolyLine(Vertices=list_item_11, Closed=False)

# ---- group: Nose->Left Ear
panel_13 = Panel("""0
15
17""")
list_item_12 = ListItem(List=construct_point_5, Index=panel_13, Wrap=True)
polyline_8 = PolyLine(Vertices=list_item_12, Closed=False)

# ----
list_item_13 = ListItem(List=construct_point_5, Index=panel_5, Wrap=True)
list_item_14 = ListItem(List=construct_point_5, Index="0", Wrap=True)
panel_14 = Panel("""2
5""")
panel_15 = Panel("""2
5
11
8""")

# ---- group: Nose-Neck
panel_16 = Panel("""0
1""")
list_item_15 = ListItem(List=construct_point_6, Index=panel_16, Wrap=True)
polyline_9 = PolyLine(Vertices=list_item_15, Closed=False)

# ---- group: Neck->Right Wrist
panel_17 = Panel("""1
2
3
4""")
list_item_16 = ListItem(List=construct_point_6, Index=panel_17, Wrap=True)
polyline_10 = PolyLine(Vertices=list_item_16, Closed=False)

# ---- group: Neck->Left Wrist
panel_18 = Panel("""1
5
6
7""")
list_item_17 = ListItem(List=construct_point_6, Index=panel_18, Wrap=True)
polyline_11 = PolyLine(Vertices=list_item_17, Closed=False)

# ---- group: Left Hip <->Right Hip
panel_19 = Panel("""8
11""")
list_item_18 = ListItem(List=construct_point_6, Index=panel_19, Wrap=True)
polyline_12 = PolyLine(Vertices=list_item_18, Closed=False)

# ---- group: Right Shoulder->Right Feet
panel_20 = Panel("""2
8
9
10""")
list_item_19 = ListItem(List=construct_point_6, Index=panel_20, Wrap=True)
polyline_13 = PolyLine(Vertices=list_item_19, Closed=False)

# ---- group: Left Shoulder->Left Feet
panel_21 = Panel("""5
11
12
13""")
list_item_20 = ListItem(List=construct_point_6, Index=panel_21, Wrap=True)
polyline_14 = PolyLine(Vertices=list_item_20, Closed=False)

# ---- group: Nose->Right Ear
panel_22 = Panel("""0
14
16""")
list_item_21 = ListItem(List=construct_point_6, Index=panel_22, Wrap=True)
polyline_15 = PolyLine(Vertices=list_item_21, Closed=False)

# ---- group: Nose->Left Ear
panel_23 = Panel("""0
15
17""")
list_item_22 = ListItem(List=construct_point_6, Index=panel_23, Wrap=True)
polyline_16 = PolyLine(Vertices=list_item_22, Closed=False)

# ----
polyline_17 = PolyLine(Vertices=list_item_13, Closed=False)
nose_pt = Point(list_item_14)
list_item_23 = ListItem(List=construct_point_6, Index=panel_14, Wrap=True)
list_item_24 = ListItem(List=construct_point_6, Index="0", Wrap=True)
list_item_25 = ListItem(List=construct_point_6, Index=panel_15, Wrap=True)
polyline_18 = PolyLine(Vertices=list_item_25, Closed=invert(False))
polyline_19 = PolyLine(Vertices=list_item_23, Closed=False)
nose_pt_2 = Point(list_item_24)
curve_closest_point = CurveClosestPoint(Point=nose_pt, Curve=polyline_17)  # -> Point, Parameter, Distance
curve_closest_point_2 = CurveClosestPoint(Point=nose_pt_2, Curve=polyline_19)  # -> Point, Parameter, Distance
unit_z = UnitZ(Factor=1)

merge = Merge(
    Data1=polyline,
    Data2=polyline_2,
    Data3=polyline_3,
    Data4=polyline_4,
    Data5=polyline_5,
    Data6=polyline_6,
    Data7=polyline_7,
    Data8=polyline_8)

unit_z_2 = UnitZ(Factor=1)
line_sdl = LineSDL(Start=curve_closest_point.Point, Direction=unit_z, Length=1)

merge_2 = Merge(
    Data1=polyline_9,
    Data2=polyline_10,
    Data3=polyline_11,
    Data4=polyline_12,
    Data5=polyline_13,
    Data6=polyline_14,
    Data7=polyline_15,
    Data8=polyline_16)

line_sdl_2 = LineSDL(Start=curve_closest_point_2.Point, Direction=unit_z_2, Length=1)
line_line = LineLine(LineA=line_sdl, LineB=polyline_17)
line_line_2 = LineLine(LineA=line_sdl_2, LineB=polyline_19)
project = Project(Geometry=polyline_18, Plane=line_line_2)  # -> Geometry, Transform
project_2 = Project(Geometry=polyline_10, Plane=line_line_2)  # -> Geometry, Transform
project_3 = Project(Geometry=polyline_11, Plane=line_line_2)  # -> Geometry, Transform
project_4 = Project(Geometry=polyline_13, Plane=line_line_2)  # -> Geometry, Transform
project_5 = Project(Geometry=polyline_14, Plane=line_line_2)  # -> Geometry, Transform
plane_origin = PlaneOrigin(Base=line_line_2, Origin=nose_pt_2)
number_slider = Slider(0.07, range=0..0.1)
circle = Circle(Plane=plane_origin, Radius=Slider(0.2, range=0..1))
project_6 = Project(Geometry=circle, Plane=line_line_2)  # -> Geometry, Transform
negative_4 = Negative(Value=number_slider)
negative_5 = Negative(Value=number_slider)
negative_6 = Negative(Value=number_slider)
negative_7 = Negative(Value=number_slider)
offset_curve = OffsetCurve(Curve=project.Geometry, Distance=number_slider, Corners=3)
offset_curve_2 = OffsetCurve(Curve=project_2.Geometry, Distance=[number_slider, negative_4], Corners=3)
offset_curve_3 = OffsetCurve(Curve=project_3.Geometry, Distance=[number_slider, negative_5], Corners=3)
offset_curve_4 = OffsetCurve(Curve=project_4.Geometry, Distance=[number_slider, negative_6], Corners=3)
offset_curve_5 = OffsetCurve(Curve=project_5.Geometry, Distance=[number_slider, negative_7], Corners=3)
flatten_tree_3 = FlattenTree(Tree=offset_curve_2, Path="{0}")
flatten_tree_4 = FlattenTree(Tree=offset_curve_3, Path="{0}")
flatten_tree_5 = FlattenTree(Tree=offset_curve_4, Path="{0}")
flatten_tree_6 = FlattenTree(Tree=offset_curve_5, Path="{0}")
flip_curve = FlipCurve(Curve=flatten_tree_3)  # -> Curve, Flag
flip_curve_2 = FlipCurve(Curve=flatten_tree_4)  # -> Curve, Flag
flip_curve_3 = FlipCurve(Curve=flatten_tree_5)  # -> Curve, Flag
flip_curve_4 = FlipCurve(Curve=flatten_tree_6)  # -> Curve, Flag
list_item_26 = ListItem(List=flatten_tree_3, Index=0, Wrap=True)  # -> Item, Item1
list_item_27 = ListItem(List=flatten_tree_4, Index=0, Wrap=True)  # -> Item, Item1
list_item_28 = ListItem(List=flatten_tree_5, Index=0, Wrap=True)  # -> Item, Item1
list_item_29 = ListItem(List=flatten_tree_6, Index=0, Wrap=True)  # -> Item, Item1
arcblend = ArcBlend(CurveA=list_item_26.Item, CurveB=list_item_26.Item1, Ratio=Slider(0.5, range=0..1))
arcblend_2 = ArcBlend(CurveA=list_item_27.Item, CurveB=list_item_27.Item1, Ratio=Slider(0.5, range=0..1))
arcblend_3 = ArcBlend(CurveA=list_item_28.Item, CurveB=list_item_28.Item1, Ratio=Slider(0.5, range=0..1))
arcblend_4 = ArcBlend(CurveA=list_item_29.Item, CurveB=list_item_29.Item1, Ratio=Slider(0.5, range=0..1))
list_item_30 = ListItem(List=flip_curve.Curve, Index=0, Wrap=True)  # -> Item, Item1
list_item_31 = ListItem(List=flip_curve_2.Curve, Index=0, Wrap=True)  # -> Item, Item1
list_item_32 = ListItem(List=flip_curve_3.Curve, Index=0, Wrap=True)  # -> Item, Item1
list_item_33 = ListItem(List=flip_curve_4.Curve, Index=0, Wrap=True)  # -> Item, Item1
arcblend_5 = ArcBlend(CurveA=list_item_30.Item, CurveB=list_item_30.Item1, Ratio=Slider(0.5, range=0..1))
arcblend_6 = ArcBlend(CurveA=list_item_31.Item, CurveB=list_item_31.Item1, Ratio=Slider(0.5, range=0..1))
arcblend_7 = ArcBlend(CurveA=list_item_32.Item, CurveB=list_item_32.Item1, Ratio=Slider(0.5, range=0..1))
arcblend_8 = ArcBlend(CurveA=list_item_33.Item, CurveB=list_item_33.Item1, Ratio=Slider(0.5, range=0..1))
merge_3 = Merge(Data1=arcblend_5, Data2=arcblend, Data3=flatten_tree_3)
merge_4 = Merge(Data1=arcblend_6, Data2=arcblend_2, Data3=flatten_tree_4)
merge_5 = Merge(Data1=arcblend_7, Data2=arcblend_3, Data3=flatten_tree_5)
merge_6 = Merge(Data1=arcblend_8, Data2=arcblend_4, Data3=flatten_tree_6)
join_curves = JoinCurves(Curves=merge_3, Preserve=False)
join_curves_2 = JoinCurves(Curves=merge_4, Preserve=False)
join_curves_3 = JoinCurves(Curves=merge_5, Preserve=False)
join_curves_4 = JoinCurves(Curves=merge_6, Preserve=False)
merge_7 = Merge(
    Data1=project_6.Geometry,
    Data2=offset_curve,
    Data3=join_curves,
    Data4=join_curves_2,
    Data5=join_curves_3,
    Data6=join_curves_4)  # -> flatten(Result)
region_union = RegionUnion(Curves=merge_7, Plane=line_line_2)
xy_plane_2 = XYPlane(Origin=Point(0, 0, 0))
deconstruct_plane_3 = DeconstructPlane(Plane=xy_plane_2)  # -> Origin, XAxis, YAxis, ZAxis
construct_domain = ConstructDomain(DomainStart=Slider(-1, range=-1..1), DomainEnd=Slider(1, range=-1..1))
construct_domain_2 = ConstructDomain(DomainStart=Slider(0, range=0..100), DomainEnd=Slider(2, range=0..10))
xz_plane = XZPlane(Origin=Point(0, 0, 0))
negative_8 = Negative(Value=deconstruct_plane_3.XAxis)
construct_point_7 = ConstructPoint(XCoordinate=0, YCoordinate=0, ZCoordinate=Slider(1.3, range=1.2..2))
rectangle = Rectangle(Plane=xz_plane, XSize=construct_domain, YSize=construct_domain_2, Radius=0)  # -> Rectangle, Length
construct_plane_2 = ConstructPlane(Origin=deconstruct_plane_3.Origin, XAxis=deconstruct_plane_3.ZAxis, YAxis=negative_8)
plane_origin_2 = PlaneOrigin(Base=construct_plane_2, Origin=construct_point_7)
orient_2 = Orient(Geometry=merge, Source=line_line, Target=plane_origin_2)  # -> Geometry, Transform
orient_3 = Orient(Geometry=region_union, Source=line_line_2, Target=plane_origin_2)  # -> Geometry, Transform
length = Length(Curve=orient_3.Geometry)
sort_list = SortList(Keys=length, ValuesValuesA=orient_3.Geometry)  # -> Keys, ValuesValuesA
list_item_34 = ListItem(List=reverse(sort_list.ValuesValuesA), Index=0, Wrap=True)
number_slider_2 = Slider(3, range=0..10)
region_difference = RegionDifference(CurvesA=rectangle.Rectangle, CurvesB=list_item_34)
boundary_surfaces = BoundarySurfaces(Edges=region_difference)
unit_y = UnitY(Factor=number_slider_2)
trigger_3 = Trigger(Interval=50, TimerInterval=50, Target=ghpython_script)
move = Move(Geometry=boundary_surfaces, Motion=unit_y)  # -> Geometry, Transform
construct_domain_3 = ConstructDomain(DomainStart=0, DomainEnd=number_slider_2)
ghpython_script = GhPythonScript(x=Button())  # -> out, a
# ---------- ghpython_script: Python ----------
import time

# Define inputs
button = x  # Button input

# Define outputs
output = 0  # Initial output value

# Initialize static variables
if 'is_button_pressed' not in globals():
    is_button_pressed = False
    start_time = None
    progress = 0
    duration = 1  # Duration in seconds for output to change from 0 to 1

# Check if the button is pressed
if button and not is_button_pressed:
    # Button pressed
    is_button_pressed = True
    start_time = time.time()
    progress = 0
elif not button and is_button_pressed:
    # Button released
    is_button_pressed = False

# Update the output if the button has been released
if start_time is not None and not is_button_pressed:
    elapsed_time = time.time() - start_time
    if elapsed_time < duration:
        progress = elapsed_time / duration
    else:
        progress = 1

# Output the result
a = progress
# ---------- end ghpython_script ----------
graph_mapper = GraphMapper(
    ghpython_script.a,
    x0=0,
    x1=1,
    y0=0,
    y1=1,
    container_name="Bezier",
    cpx=[0, 0.3678526878, 0.7361370325, 1],
    cpy=[0, 0, 1, 1])
remap_numbers = RemapNumbers(Value=graph_mapper, Source=Domain(0, 1), Target=construct_domain_3)  # -> Mapped, Clipped
panel_24 = Panel(ghpython_script.a)
unit_y_2 = UnitY(Factor=remap_numbers.Mapped)
negative_9 = Negative(Value=unit_y_2)
move_2 = Move(Geometry=move.Geometry, Motion=negative_9)  # -> Geometry, Transform
orient_4 = Orient(Geometry=move_2.Geometry, Source=xy_plane, Target=construct_plane)  # -> Geometry, Transform
gh2unity_mesh = GH2Unity_Mesh(Meshes=orient_4.Geometry, Mats=ColourSwatch(SwatchColor=RGB(255, 255, 255)))  # -> Outmeshes, Outmats
brep_curve = BrepCurve(Brep=move_2.Geometry, Curve=orient_2.Geometry)  # -> Curves, Points
list_length = ListLength(List=flatten(brep_curve.Curves))
panel_25 = Panel(list_length)
larger_than = LargerThan(FirstNumber=list_length, SecondNumber="0")  # -> LargerThan, OrEqualTo
data_recorder_2 = DataRecorder(larger_than.LargerThan, DataLimit=-10, RecordData=False)
panel_26 = Panel(data_recorder_2)
stream_filter = StreamFilter(Gate=larger_than.LargerThan, Stream0="Win", Stream1="Fail")
panel_27 = Panel(stream_filter)
